# Dynamo graph Corner Trim Genretaor v 1.2 .dyn "Corner Trim Genretaor v 1.2" (Dynamo 2.16.2.5624)
# packages: Rhythm 2023.9.1

# group: Siding Base Line
siding_base_line = UnitInput("0 in", UnitType="autodesk.unit.unit:inches-1.0.1")  # graph input
convert_by_units = DynamoUnitConvert(siding_base_line.Value, MeasurementType="autodesk.unit.quantity:length-1.0.4", FromConversion="autodesk.unit.unit:inches-1.0.1", ToConversion="autodesk.unit.unit:feet-1.0.1")

# group: Select edge
c_t_corner_trim_edges = SelectEdges()  # 1 picked in the model; graph input
length = Curve.Length(curve=c_t_corner_trim_edges)
add = length + convert_by_units

# group: Point location
startPoint = Curve.StartPoint(curve=c_t_corner_trim_edges)
X = Point.X(point=startPoint)
Y = Point.Y(point=startPoint)
Z = Point.Z(point=startPoint)
endPoint = Curve.EndPoint(curve=c_t_corner_trim_edges)
Z_2 = Point.Z(point=endPoint)
min = Math.Min(value1=Z, value2=Z_2)
code_block = CodeBlock(y=min, x=convert_by_units) { y-x; }
byCoordinates = Point.ByCoordinates(x=X, y=Y, z=code_block)

# group: Get Vertical Trim
string = StringInput("WTS_Trim_Exterior_Corner_1")
byName = Family.ByName(name=string)
types = Family.Types(family=byName)
code_block_2 = CodeBlock { 0; }
getItemAtIndex = List.GetItemAtIndex(list=types, index=code_block_2)
byPoint = FamilyInstance.ByPoint(familyType=getItemAtIndex, point=byCoordinates)

# group: Trims Data
code_block_3 = CodeBlock { "Height"; }
ʳʰʸᵗʰᵐ_elements = Rhythm.Revit.Elements.Elements.SetParameterByNameTypeOrInstance(element=byPoint, parameterName=code_block_3, value=add)

# group: Depth
depth_value = UnitInput("4 in", UnitType="autodesk.unit.unit:inches-1.0.1")  # graph input
convert_by_units_2 = DynamoUnitConvert(depth_value.Value, MeasurementType="autodesk.unit.quantity:length-1.0.4", FromConversion="autodesk.unit.unit:inches-1.0.1", ToConversion="autodesk.unit.unit:feet-1.0.1")
code_block_4 = CodeBlock { "Depth"; }
ʳʰʸᵗʰᵐ_elements_2 = Rhythm.Revit.Elements.Elements.SetParameterByNameTypeOrInstance(element=byPoint, parameterName=code_block_4, value=convert_by_units_2)

# group: Width
code_block_5 = CodeBlock { "Width"; }
lock_depth_with_width = BoolSelector(true)  # graph input
width_value = UnitInput("4 in", UnitType="autodesk.unit.unit:feet-1.0.1")  # graph input
convert_by_units_3 = DynamoUnitConvert(width_value.Value, MeasurementType="autodesk.unit.quantity:length-1.0.4", FromConversion="autodesk.unit.unit:inches-1.0.1", ToConversion="autodesk.unit.unit:feet-1.0.1")
if_ = RefactoredIf(test=lock_depth_with_width, true=convert_by_units_2, false=convert_by_units_3)
ʳʰʸᵗʰᵐ_elements_3 = Rhythm.Revit.Elements.Elements.SetParameterByNameTypeOrInstance(element=byPoint, parameterName=code_block_5, value=if_)

# group: Thickness
code_block_6 = CodeBlock { "Thickness"; }
thickness = UnitInput("1 in", UnitType="autodesk.unit.unit:inches-1.0.1")  # graph input
convert_by_units_4 = DynamoUnitConvert(thickness.Value, MeasurementType="autodesk.unit.quantity:length-1.0.4", FromConversion="autodesk.unit.unit:inches-1.0.1", ToConversion="autodesk.unit.unit:feet-1.0.1")
ʳʰʸᵗʰᵐ_elements_4 = Rhythm.Revit.Elements.Elements.SetParameterByNameTypeOrInstance(element=byPoint, parameterName=code_block_6, value=convert_by_units_4)
