# Dynamo graph Line Corner Genrator.dyn (Dynamo 2.16.2.5624)
# packages: Clockwork for Dynamo 2.x 2.6.0

# group: Wall Sweep Join
categories = Categories("OST_Cornices")
all_elements_of_category = ElementsOfCategory(Category=categories)
categories_2 = Categories("OST_Walls")
all_elements_of_category_2 = ElementsOfCategory(Category=categories_2)
joinGeometry = Custom[Element.JoinGeometry](element1=all_elements_of_category, element2=all_elements_of_category_2, lacing=CrossProduct)  # package Clockwork for Dynamo 2.x; Joins two model elements (if possible). Only works inside the project environment.

# group: Elements Join
categories_3 = Categories("OST_Walls")
all_elements_of_category_3 = ElementsOfCategory(Category=categories_3)
categories_4 = Categories("OST_RoofSoffit")
all_elements_of_category_4 = ElementsOfCategory(Category=categories_4)
categories_5 = Categories("OST_Roofs")
all_elements_of_category_5 = ElementsOfCategory(Category=categories_5)
categories_6 = Categories("OST_Ceilings")
all_elements_of_category_6 = ElementsOfCategory(Category=categories_6)
list_create = List.Create(item0=all_elements_of_category_4, item1=all_elements_of_category_5, item2=all_elements_of_category_6)
joinGeometry_2 = Custom[Element.JoinGeometry](element1=all_elements_of_category_3, element2=list_create, lacing=CrossProduct)
