# Dynamo graph corner trim generator v 1.1.dyn "Trim Assistance v 1.1" (Dynamo 2.16.2.5624)
# packages: Rhythm 2023.9.1, Clockwork for Dynamo 2.x 2.6.0

# group: Select edge
c_t_corner_trim_edges = SelectEdges()  # 1 picked in the model; graph input
length = Curve.Length(curve=c_t_corner_trim_edges)

# group: Point location
startPoint = Curve.StartPoint(curve=c_t_corner_trim_edges)
X = Point.X(point=startPoint)
Y = Point.Y(point=startPoint)
Z = Point.Z(point=startPoint)
endPoint = Curve.EndPoint(curve=c_t_corner_trim_edges)
Z_2 = Point.Z(point=endPoint)
min = Math.Min(value1=Z, value2=Z_2)
byCoordinates = Point.ByCoordinates(x=X, y=Y, z=min)

# group: Get Vertical Trim
string = StringInput("WTS_Trim_Exterior_Corner_1")
byName = Family.ByName(name=string)
types = Family.Types(family=byName)
code_block = CodeBlock { 0; }
getItemAtIndex = List.GetItemAtIndex(list=types, index=code_block)
byPoint = FamilyInstance.ByPoint(familyType=getItemAtIndex, point=byCoordinates)

# group: Trims Data
code_block_2 = CodeBlock { "Height"; }
ʳʰʸᵗʰᵐ_elements = Rhythm.Revit.Elements.Elements.SetParameterByNameTypeOrInstance(element=byPoint, parameterName=code_block_2, value=length)

# group: Depth
depth_value = UnitInput("4 in", UnitType="autodesk.unit.unit:inches-1.0.1")  # graph input
convert_by_units = DynamoUnitConvert(depth_value.Value, MeasurementType="autodesk.unit.quantity:length-1.0.4", FromConversion="autodesk.unit.unit:inches-1.0.1", ToConversion="autodesk.unit.unit:feet-1.0.1")
code_block_3 = CodeBlock { "Depth"; }
ʳʰʸᵗʰᵐ_elements_2 = Rhythm.Revit.Elements.Elements.SetParameterByNameTypeOrInstance(element=byPoint, parameterName=code_block_3, value=convert_by_units)

# group: Width
code_block_4 = CodeBlock { "Width"; }
lock_depth_with_width = BoolSelector(true)  # graph input
width_value = UnitInput("4 in", UnitType="autodesk.unit.unit:feet-1.0.1")  # graph input
convert_by_units_2 = DynamoUnitConvert(width_value.Value, MeasurementType="autodesk.unit.quantity:length-1.0.4", FromConversion="autodesk.unit.unit:inches-1.0.1", ToConversion="autodesk.unit.unit:feet-1.0.1")
if_ = RefactoredIf(test=lock_depth_with_width, true=convert_by_units, false=convert_by_units_2)
ʳʰʸᵗʰᵐ_elements_3 = Rhythm.Revit.Elements.Elements.SetParameterByNameTypeOrInstance(element=byPoint, parameterName=code_block_4, value=if_)

categories = Categories("OST_Walls")
all_elements_of_category = ElementsOfCategory(Category=categories)
categories_2 = Categories("OST_RoofSoffit")
all_elements_of_category_2 = ElementsOfCategory(Category=categories_2)
categories_3 = Categories("OST_Roofs")
all_elements_of_category_3 = ElementsOfCategory(Category=categories_3)
categories_4 = Categories("OST_Ceilings")
all_elements_of_category_4 = ElementsOfCategory(Category=categories_4)
list_create = List.Create(item0=all_elements_of_category_2, item1=all_elements_of_category_3, item2=all_elements_of_category_4)
joinGeometry = Custom[Element.JoinGeometry](element1=all_elements_of_category, element2=list_create, lacing=CrossProduct)  # package Clockwork for Dynamo 2.x; Joins two model elements (if possible). Only works inside the project environment.
categories_5 = Categories("OST_Cornices")
all_elements_of_category_5 = ElementsOfCategory(Category=categories_5)
categories_6 = Categories("OST_Walls")
all_elements_of_category_6 = ElementsOfCategory(Category=categories_6)
joinGeometry_2 = Custom[Element.JoinGeometry](element1=all_elements_of_category_5, element2=all_elements_of_category_6, lacing=CrossProduct)

# group: Thickness
code_block_5 = CodeBlock { "Thickness"; }
thickness = UnitInput("1 in", UnitType="autodesk.unit.unit:inches-1.0.1")  # graph input
convert_by_units_3 = DynamoUnitConvert(thickness.Value, MeasurementType="autodesk.unit.quantity:length-1.0.4", FromConversion="autodesk.unit.unit:inches-1.0.1", ToConversion="autodesk.unit.unit:feet-1.0.1")
ʳʰʸᵗʰᵐ_elements_4 = Rhythm.Revit.Elements.Elements.SetParameterByNameTypeOrInstance(element=byPoint, parameterName=code_block_5, value=convert_by_units_3)
