# Dynamo graph corner trim generator v 1.dyn "corner trim" (Dynamo 2.16.2.5624)
# packages: Rhythm 2023.9.1

# group: Select edge
c_t_corner_trim_edges = SelectEdges()  # 6 picked in the model; graph input
length = Curve.Length(curve=c_t_corner_trim_edges)

# group: Point location
startPoint = Curve.StartPoint(curve=c_t_corner_trim_edges)
X = Point.X(point=startPoint)
Y = Point.Y(point=startPoint)
Z = Point.Z(point=startPoint)
endPoint = Curve.EndPoint(curve=c_t_corner_trim_edges)
Z_2 = Point.Z(point=endPoint)
min = Math.Min(value1=Z, value2=Z_2)
byCoordinates = Point.ByCoordinates(x=X, y=Y, z=min)

# group: Get Vertical Trim
string = StringInput("WTS_Trim_Exterior_Corner_1")
byName = Family.ByName(name=string)
types = Family.Types(family=byName)
code_block = CodeBlock { 0; }
getItemAtIndex = List.GetItemAtIndex(list=types, index=code_block)
byPoint = FamilyInstance.ByPoint(familyType=getItemAtIndex, point=byCoordinates)

# group: Trims Data
code_block_2 = CodeBlock { "Height"; }
ʳʰʸᵗʰᵐ_elements = Rhythm.Revit.Elements.Elements.SetParameterByNameTypeOrInstance(element=byPoint, parameterName=code_block_2, value=length)
